# Grasshopper definition flyingSpaghettiMonster.gh (Grasshopper 1.0.7)
# plug-ins: Wallacei

# ---- group: The Crew
# READ ME
# The Idea here is:
# Be it needing to squeeze a bit more performance out to meet PH criteria
# Wanting to explore design options and variables and how they  effect the Verification sheet of the PHPP.
# Or assigning cost factors to each of the material or assembly options as a theoretical workflow to spend less and build the best, explore, learn, and help buid better buildings. (not that anyone reading this doesnt build great buildings; this is just the workflow I have been exploring and wanted to share it.
ladybug = Ladybug_Ladybug()  # -> out; plug-in component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
honeybee = Honeybee_Honeybee()  # -> out; plug-in component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
idf2phpp = BT_CORE()  # -> out; plug-in component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

# ---- group: building orientation
wlc_1 = GenePool(Decimals=2, Maximum=5, Minimum=-5, Value=-0.03)

# ---- group: Roof crest height
wlc_2 = GenePool(Decimals=2, Maximum=2, Minimum=0.5, Value=0.5)

# ----
# Frame Pool
wlc_6 = GenePool(Decimals=0, Maximum=9, Minimum=0, Value=4)
frame_uvalues = Panel(""".80
.79
.78
.80
.81
.71
.83
.78
.80
.72""")
frame_widths = Panel(""".125
.116
.178
.119
.108
.150
.150
.124
.111
.125""")
list_item = ListItem(List=frame_widths, Index=wlc_6, Wrap=True)
list_item_2 = ListItem(List=frame_uvalues, Index=wlc_6, Wrap=True)

wlc_7 = GenePool(Decimals=0, Maximum=9, Minimum=0, Value=1)

# ----
# Glazing pool
ug_val_list = Panel(""".51
.44
.59
.56
.53
.56
.49
.64
.61
.58""")
g_val_list = Panel(""".42
.42
.42
.42
.42
.51
.51
.51
.51
.51""")
list_item_3 = ListItem(List=ug_val_list, Index=wlc_7, Wrap=True)
list_item_4 = ListItem(List=g_val_list, Index=wlc_7, Wrap=True)
new_phpp_glazing = BT_CreatePHPPwindowGlazing(name="testevoglazing", uValue=list_item_3, gValue=list_item_4)  # -> out, PHPPGlazing; plug-in component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

new_phpp_frame = BT_CreatePHPPwindowFrame(name="framesevotest", frameWidths=list_item, frameUvalues=list_item_2, psiGlazings=".009", psiInstalls=".009")  # -> out, PHPPFrame; inputs frameWidths: list, frameUvalues: list, psiGlazings: list, psiInstalls: list; plug-in component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
panel = Panel("evowindow")
window_names = Panel("""w0
w1
w2
w3
w4
w5""")
# Create HB Zone
panel_2 = Panel("example_zone")

# ---- group: Randomize genepools
gene_pool_and_slider_shuffler = GenePoolAndSliderShuffler(BooleanButton=Toggle(False))

# ---- group: Set source PHPP
file_path = FilePath()

# ----
# Building Geometry
# ^^^^ Name surfaces in Rhino
curve = Curve(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)
deconstruct_brep = DeconstructBrep(Brep=curve)  # -> Faces, Edges, Vertices
area = Area(Geometry=deconstruct_brep.Faces)  # -> Area, Centroid
unit_z = UnitZ(Factor=1)
move = Move(Geometry=area.Centroid, Motion=unit_z)  # -> Geometry, Transform
line = Line(StartPoint=area.Centroid, EndPoint=move.Geometry)
rotate_axis = RotateAxis(Geometry=curve, Angle=degrees(wlc_1), Axis=line)  # -> Geometry, Transform
unit_z_2 = UnitZ(Factor=wlc_2)
deconstruct_brep_2 = DeconstructBrep(Brep=rotate_axis.Geometry)  # -> Faces, Edges, Vertices
unit_z_3 = UnitZ(Factor="3")
move_2 = Move(Geometry=rotate_axis.Geometry, Motion=unit_z_3)  # -> Geometry, Transform
deconstruct_brep_3 = DeconstructBrep(Brep=move_2.Geometry)  # -> Faces, Edges, Vertices
list_item_5 = ListItem(List=deconstruct_brep_3.Edges, Index=0, Wrap=True)  # -> Item, Item1, Item2, Item3
curve_2 = Curve(list_item_5.Item3)
curve_3 = Curve(list_item_5.Item1)
curve_middle = CurveMiddle(Curve=curve_2)
curve_middle_2 = CurveMiddle(Curve=curve_3)
line_2 = Line(StartPoint=curve_middle_2, EndPoint=curve_middle)
list_item_6 = ListItem(List=deconstruct_brep_3.Vertices, Index=0, Wrap=True)  # -> Item, Item1, Item2, Item3
list_item_7 = ListItem(List=deconstruct_brep_3.Edges, Index=0, Wrap=True)  # -> Item, Item1, Item2, Item3
move_3 = Move(Geometry=line_2, Motion=unit_z_2)  # -> Geometry, Transform
end_points = EndPoints(Curve=move_3.Geometry)  # -> Start, End
line_3 = Line(StartPoint=end_points.End, EndPoint=list_item_6.Item)
line_4 = Line(StartPoint=end_points.End, EndPoint=list_item_6.Item3)
line_5 = Line(StartPoint=end_points.Start, EndPoint=list_item_6.Item2)
line_6 = Line(StartPoint=end_points.Start, EndPoint=list_item_6.Item1)
extrude = Extrude(Base=deconstruct_brep_2.Edges, Direction=unit_z_3)

curve_4 = Curve(list_item_7.Item)
curve_5 = Curve(list_item_7.Item1)
curve_6 = Curve(list_item_7.Item2)
curve_7 = Curve(list_item_7.Item3)

boundary_surfaces = BoundarySurfaces(Edges=[curve_5, line_6, line_5])
boundary_surfaces_2 = BoundarySurfaces(Edges=[move_3.Geometry, line_4, line_5, curve_6])
boundary_surfaces_3 = BoundarySurfaces(Edges=[move_3.Geometry, line_3, line_6, curve_4])
boundary_surfaces_4 = BoundarySurfaces(Edges=[line_3, line_4, curve_7])
brep_join = BrepJoin(Breps=[extrude, boundary_surfaces_2, boundary_surfaces_3, boundary_surfaces_4, boundary_surfaces, deconstruct_brep_2.Faces])  # -> Breps, Closed

deconstruct_brep_4 = DeconstructBrep(Brep=brep_join.Breps)  # -> Faces, Edges, Vertices
list_item_8 = ListItem(List=deconstruct_brep_4.Faces, Index=0, Wrap=True)  # -> Item, Item1, Item2, Item3, Item4, Item5, Item6, Item7, Item8

# ---- group: Wall_XZ
surface = Surface(list_item_8.Item)

# ---- group: Wall_x+yz
surface_2 = Surface(list_item_8.Item2)

# ---- group: Wall_yz
surface_3 = Surface(list_item_8.Item3)

# ---- group: Roof/wall
surface_4 = Surface(list_item_8.Item6)
surface_5 = Surface(list_item_8.Item7)

# ---- group: Wall_+xy
surface_6 = Surface(list_item_8.Item1)

# ---- group: Roof+y
surface_7 = Surface(list_item_8.Item4)

# ---- group: Roof
surface_8 = Surface(list_item_8.Item5)

# ----
brep = Brep([surface, surface_6, surface_2, surface_3, surface_4, surface_5])
brep_2 = Brep([surface_7, surface_8])

# ---- group: Floor
surface_9 = Surface(list_item_8.Item8)

# ----
# Floor pool
d_thiccness = Panel(""".540
.640
.485
.468
.390""")
u_value = Panel(""".155
.163
.129
.114
.150""")
# d (not needed in current setup)
wlc_3 = GenePool(Decimals=0, Maximum=4, Minimum=0, Value=3)
list_item_9 = ListItem(List=u_value, Index=wlc_3, Wrap=True)
list_item_10 = ListItem(List=d_thiccness, Index=wlc_3, Wrap=True)
division = Division(A="1", B=list_item_9)
epnomassmat = Honeybee_EnergyPlusNoMassOpaqueMaterial(name="evo_floor_test", R_Value=division)  # -> EPMaterial; plug-in component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
epconstruction = Honeybee_EnergyPlusConstruction(name="evo_floor_selection_test", layer_1=epnomassmat)  # -> EPConstruction; plug-in component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
createhbsrfs = Honeybee_createHBSrfs(geometry=surface_9, srfName="Floor", srfType=2.5, EPBC="Ground", EPConstruction=epconstruction)  # -> out, simplify(HBSurface); plug-in component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

# ----
# A big mess.. dont judge me plz
unit_z_4 = UnitZ(Factor=1)
unit_z_5 = UnitZ(Factor=1)
wlc_8 = GenePool(Decimals=2, Maximum=7, Minimum=2.5, Value=4.97)
wlc_9 = GenePool(Decimals=2, Maximum=1.5, Minimum=0.5, Value=1.5)
division_2 = Division(A=wlc_9, B="2")
division_3 = Division(A=wlc_9, B="2")

# ----
# Roof Pool
d_thiccness_2 = Panel(""".448
.478
.318
.420
.525
.448
.546
.475
.527""")
wlc_5 = GenePool(Decimals=0, Maximum=8, Minimum=0, Value=6)
list_item_11 = ListItem(List=d_thiccness_2, Index=wlc_5, Wrap=True)
u_value_2 = Panel(""".098
.102
.150
.101
.095
.098
.087
.106
.109""")
list_item_12 = ListItem(List=u_value_2, Index=wlc_5, Wrap=True)

division_4 = Division(A="1", B=list_item_12)
epnomassmat_2 = Honeybee_EnergyPlusNoMassOpaqueMaterial(name="evo_roof_selection_test", R_Value=division_4)  # -> EPMaterial; plug-in component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

epconstruction_2 = Honeybee_EnergyPlusConstruction(name="roof_evo_test", layer_1=epnomassmat_2)  # -> EPConstruction; plug-in component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
createhbsrfs_2 = Honeybee_createHBSrfs(geometry=brep_2, srfName="Roofs", srfType=1, EPBC="Outdoors", EPConstruction=epconstruction_2)  # -> out, simplify(HBSurface); plug-in component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

# ----
# Wall Pool
wlc_4 = GenePool(Decimals=0, Maximum=9, Minimum=0, Value=4)
d_thiccness_3 = Panel(""".381
.372
.500
.410
.500
.338
.455
.500
.363
.419""")
u_value_3 = Panel(""".121
.107
.102
.119
.102
.115
.145
.102
.128
.104""")
list_item_13 = ListItem(List=d_thiccness_3, Index=wlc_4, Wrap=True)
list_item_14 = ListItem(List=u_value_3, Index=wlc_4, Wrap=True)

division_5 = Division(A="1", B=list_item_14)
epnomassmat_3 = Honeybee_EnergyPlusNoMassOpaqueMaterial(name="evo_wall_selection_test", R_Value=division_5)  # -> EPMaterial; plug-in component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

epconstruction_3 = Honeybee_EnergyPlusConstruction(name="wall_evo_test", layer_1=epnomassmat_3)  # -> EPConstruction; plug-in component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
createhbsrfs_3 = Honeybee_createHBSrfs(geometry=brep, srfName="Walls", srfType=0, EPBC="Outdoors", EPConstruction=epconstruction_3)  # -> out, simplify(HBSurface); plug-in component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

list_item_15 = ListItem(List=flatten(createhbsrfs_3.HBSurface), Index=0, Wrap=True)  # -> Item, Item1, Item2, Item3, Item4, Item5
deconstruct_brep_5 = DeconstructBrep(Brep=list_item_15.Item2)  # -> Faces, Edges, Vertices
deconstruct_brep_6 = DeconstructBrep(Brep=list_item_15.Item)  # -> Faces, Edges, Vertices
list_item_16 = ListItem(List=deconstruct_brep_5.Edges, Index=0, Wrap=True)  # -> Item, Item1, Item2, Item3
list_item_17 = ListItem(List=deconstruct_brep_6.Edges, Index=0, Wrap=True)  # -> Item, Item1, Item2, Item3
move_4 = Move(Geometry=list_item_16.Item3, Motion=unit_z_4)  # -> Geometry, Transform
move_5 = Move(Geometry=list_item_17.Item3, Motion=unit_z_5)  # -> Geometry, Transform
curve_middle_3 = CurveMiddle(Curve=move_4.Geometry)
curve_middle_4 = CurveMiddle(Curve=move_5.Geometry)
end_points_2 = EndPoints(Curve=move_5.Geometry)  # -> Start, End
vector_2pt = Vector2Pt(PointA=end_points_2.Start, PointB=end_points_2.End, Unitize=False)  # -> Vector, Length
reverse = Reverse(Vector=vector_2pt.Vector)
reverse_2 = Reverse(Vector=vector_2pt.Vector)
line_sdl = LineSDL(Start=curve_middle_3, Direction=reverse, Length=wlc_8)
line_sdl_2 = LineSDL(Start=curve_middle_4, Direction=reverse_2, Length=wlc_8)
line_sdl_3 = LineSDL(Start=curve_middle_3, Direction=vector_2pt.Vector, Length=wlc_8)
line_sdl_4 = LineSDL(Start=curve_middle_4, Direction=vector_2pt.Vector, Length=wlc_8)
end_points_3 = EndPoints(Curve=line_sdl)  # -> Start, End
end_points_4 = EndPoints(Curve=line_sdl_2)  # -> Start, End
end_points_5 = EndPoints(Curve=line_sdl_3)  # -> Start, End
end_points_6 = EndPoints(Curve=line_sdl_4)  # -> Start, End
line_sdl_5 = LineSDL(Start=end_points_3.End, Direction=vector_2pt.Vector, Length=wlc_9)
curve_middle_5 = CurveMiddle(Curve=line_sdl_5)
line_sdl_6 = LineSDL(Start=curve_middle_5, Direction=Vector(0, 0, 1), Length=wlc_9)
line_sdl_7 = LineSDL(Start=end_points_4.End, Direction=vector_2pt.Vector, Length=wlc_9)
curve_middle_6 = CurveMiddle(Curve=line_sdl_7)
line_sdl_8 = LineSDL(Start=curve_middle_6, Direction=Vector(0, 0, 1), Length=wlc_9)
line_sdl_9 = LineSDL(Start=curve_middle_3, Direction=vector_2pt.Vector, Length=division_2)
line_sdl_10 = LineSDL(Start=curve_middle_3, Direction=Vector(0, 0, 1), Length=wlc_9)
line_sdl_11 = LineSDL(Start=curve_middle_3, Direction=reverse, Length=division_2)
line_sdl_12 = LineSDL(Start=curve_middle_4, Direction=vector_2pt.Vector, Length=division_3)
line_sdl_13 = LineSDL(Start=curve_middle_4, Direction=Vector(0, 0, 1), Length=wlc_9)
line_sdl_14 = LineSDL(Start=curve_middle_4, Direction=reverse_2, Length=division_3)
line_sdl_15 = LineSDL(Start=end_points_5.End, Direction=reverse, Length=wlc_9)
curve_middle_7 = CurveMiddle(Curve=line_sdl_15)
line_sdl_16 = LineSDL(Start=curve_middle_7, Direction=Vector(0, 0, 1), Length=wlc_9)
line_sdl_17 = LineSDL(Start=end_points_6.End, Direction=reverse_2, Length=wlc_9)
curve_middle_8 = CurveMiddle(Curve=line_sdl_17)
line_sdl_18 = LineSDL(Start=curve_middle_8, Direction=Vector(0, 0, 1), Length=wlc_9)
end_points_7 = EndPoints(Curve=line_sdl_5)  # -> Start, End
end_points_8 = EndPoints(Curve=line_sdl_7)  # -> Start, End
end_points_9 = EndPoints(Curve=line_sdl_16)  # -> Start, End
end_points_10 = EndPoints(Curve=line_sdl_11)  # -> Start, End
end_points_11 = EndPoints(Curve=line_sdl_18)  # -> Start, End
end_points_12 = EndPoints(Curve=line_sdl_9)  # -> Start, End
end_points_13 = EndPoints(Curve=line_sdl_10)  # -> Start, End
end_points_14 = EndPoints(Curve=line_sdl_14)  # -> Start, End
end_points_15 = EndPoints(Curve=line_sdl_15)  # -> Start, End
end_points_16 = EndPoints(Curve=line_sdl_6)  # -> Start, End
end_points_17 = EndPoints(Curve=line_sdl_12)  # -> Start, End
end_points_18 = EndPoints(Curve=line_sdl_13)  # -> Start, End
end_points_19 = EndPoints(Curve=line_sdl_17)  # -> Start, End
end_points_20 = EndPoints(Curve=line_sdl_8)  # -> Start, End
rectangle_3pt = Rectangle3Pt(PointA=end_points_19.Start, PointB=end_points_19.End, PointC=end_points_11.End)  # -> Rectangle, Length
rectangle_3pt_2 = Rectangle3Pt(PointA=end_points_15.Start, PointB=end_points_15.End, PointC=end_points_9.End)  # -> Rectangle, Length
rectangle_3pt_3 = Rectangle3Pt(PointA=end_points_7.Start, PointB=end_points_7.End, PointC=end_points_16.End)  # -> Rectangle, Length
rectangle_3pt_4 = Rectangle3Pt(PointA=end_points_8.Start, PointB=end_points_8.End, PointC=end_points_20.End)  # -> Rectangle, Length
rectangle_3pt_5 = Rectangle3Pt(PointA=end_points_12.End, PointB=end_points_10.End, PointC=end_points_13.End)  # -> Rectangle, Length
rectangle_3pt_6 = Rectangle3Pt(PointA=end_points_17.End, PointB=end_points_14.End, PointC=end_points_18.End)  # -> Rectangle, Length
boundary_surfaces_5 = BoundarySurfaces(Edges=rectangle_3pt_2.Rectangle)
boundary_surfaces_6 = BoundarySurfaces(Edges=rectangle_3pt_3.Rectangle)
boundary_surfaces_7 = BoundarySurfaces(Edges=rectangle_3pt_5.Rectangle)
boundary_surfaces_8 = BoundarySurfaces(Edges=rectangle_3pt.Rectangle)
boundary_surfaces_9 = BoundarySurfaces(Edges=rectangle_3pt_4.Rectangle)
boundary_surfaces_10 = BoundarySurfaces(Edges=rectangle_3pt_6.Rectangle)
vector_2pt_2 = Vector2Pt(PointA=curve_middle_4, PointB=curve_middle_3, Unitize=False)  # -> Vector, Length
amplitude = Amplitude(Vector=vector_2pt_2.Vector, Amplitude=Slider(0, range=0..0.01))
reverse_3 = Reverse(Vector=amplitude)

move_6 = Move(Geometry=[boundary_surfaces_10, boundary_surfaces_9, boundary_surfaces_8], Motion=amplitude)  # -> Geometry, Transform
move_7 = Move(Geometry=[boundary_surfaces_5, boundary_surfaces_6, boundary_surfaces_7], Motion=reverse_3)  # -> Geometry, Transform
custom_preview = CustomPreview(Geometry=[move_6.Geometry, move_7.Geometry], Material=ColourSwatch(SwatchColor=RGB(2, 0, 0)))
createhbzones = Honeybee_createHBZones(
    name=panel_2,
    HBSurfaces=flatten([createhbsrfs.HBSurface, createhbsrfs_3.HBSurface, createhbsrfs_2.HBSurface]),
    isConditioned=True)  # -> out, HBZone; plug-in component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
new_phpp_window = BT_CreatePHPPwindow(
    HBZones=createhbzones.HBZone,
    names=window_names,
    frames=new_phpp_frame.PHPPFrame,
    glazings=new_phpp_glazing.PHPPGlazing,
    installs="0",
    windowGeom=[move_6.Geometry, move_7.Geometry])  # -> out, HBZones, windowSurfaces, windowNames, EPConstructions, windowObjs; inputs HBZones: list, names: list, frames: list, glazings: list, psi_installs: list, installs: list, EPConsts: list, windowGeom: list; plug-in component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
addhbglz = Honeybee_addHBGlz(
    HBObj=new_phpp_window.HBZones,
    childSurfaces=flatten(new_phpp_window.windowSurfaces),
    childSurfacesName=flatten(new_phpp_window.windowNames),
    EPConstructions=new_phpp_window.EPConstructions)  # -> HBObjWGLZ; plug-in component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

# ----
# Using wall assy thickness to de-rate TFA accordingly
deconstruct_brep_7 = DeconstructBrep(Brep=surface_9)  # -> Faces, Edges, Vertices
join_curves = JoinCurves(Curves=deconstruct_brep_7.Edges, Preserve=False)
offset_curve = OffsetCurve(Curve=join_curves, Distance=list_item_13, Plane=PlaneXY(0, 0, 0), Corners=1)
boundary_surfaces_11 = BoundarySurfaces(Edges=offset_curve)

# ----
# Create Interior rooms
# Very important
phpp_rooms_from_rhino = BT_PHPProomsFromRH(HBZones=addhbglz)  # -> out, roomBreps, rooms, HBZones; inputs roomTFASurfaces: list of Guid, roomGeometry: list of Guid, HBZones: list; plug-in component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
panel_3 = Panel(phpp_rooms_from_rhino.rooms)
brep_3 = Brep(phpp_rooms_from_rhino.roomBreps)

custom_preview_2 = CustomPreview(Geometry=phpp_rooms_from_rhino.roomBreps, Material=ColourSwatch(SwatchColor=RGBA(56, 19, 0, 232)))

# ----
# Eport to EPlus
panel_4 = Panel("http://climate.onebuilding.org/WMO_Region_4_North_and_Central_America/USA_United_States_of_America/NY_New_York/USA_NY_New.York-Kennedy.Intl.AP.744860_TMY3.zip")
# Name and give a home to the E+ file
panel_5 = Panel("C:\Users\TREVOR\Desktop\idf2ph\evo_v1\evo_v2")
epw_stat = Ladybug_OpenEPWAndSTATWeatherFiles(weatherFileURL=panel_4)  # -> epwFile, statFile; plug-in component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
exporttoopenstudio = Honeybee_ExportToOpenStudio(
    epwWeatherFile=epw_stat.epwFile,
    HBZones=flatten(phpp_rooms_from_rhino.HBZones),
    writeOSM=Toggle(False),
    runSimulation="3",
    fileName="evo_v2",
    workingDir=panel_5)  # -> out, osmFileAddress, idfFileAddress, resultFileAddress, eioFileAddress, rddFileAddress, htmlReport, studyFolder, model; plug-in component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
panel_6 = Panel(exporttoopenstudio.idfFileAddress)
panel_7 = Panel(exporttoopenstudio.osmFileAddress)

# ----
# Convert IDF to PHPP
read_idf_file = BT_ReadIDFfile(idfFileAddress=exporttoopenstudio.idfFileAddress)  # -> out, IDF_Objs_List, port, surfaces, fenestration, constuctions, materials; plug-in component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
panel_8 = Panel(read_idf_file.IDF_Objs_List)
idf_phpp_objs = BT_IDF2PHPPObjs(HBZones=flatten(phpp_rooms_from_rhino.HBZones), IDF_Objs_List=read_idf_file.IDF_Objs_List)  # -> out, opaqueSurfaces, windowObjects, zoneNames, PHPPObjs; inputs HBZones: list, IDF_Objs_List: list; plug-in component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

# ----
# PHPP Setup
phpp_setup = BT_SetPHPPSetup()  # -> out, verification, climate, airtightness; inputs vn50: list; plug-in component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
create_excel_obj_setup = BT_CreateXLObj_Setup(verification=phpp_setup.verification)  # -> out, toPHPP_Setup; inputs Heating_Cooling: tree, summerVent: list; plug-in component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
create_excel_obj_geom = BT_CreateXLObj_Geom(PHPPObjs=idf_phpp_objs.PHPPObjs, tfa=flatten(boundary_surfaces_11))  # -> out, toPHPP_Geom; inputs PHPPObjs: tree, zonesInclude: list, zoneExclude: list, tfa: list, thermalBridges: list, grndFloorElements: list, udRowStarts: list; plug-in component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
panel_9 = Panel(create_excel_obj_geom.toPHPP_Geom)
panel_10 = Panel(create_excel_obj_setup.toPHPP_Setup)
entwine = Entwine(Branch00=create_excel_obj_geom.toPHPP_Geom, Branch01=create_excel_obj_setup.toPHPP_Setup, FlattenInputs=True)

# ----
# Export to PHPP
where_to_put_the_new_phpp = Panel("")
name_of_the_new_phpp = Panel("")
open_xl_workbook = BT_OpenXLWorkbook(run=Toggle(False), oldFilename=file_path, newDirectory=where_to_put_the_new_phpp, newFilename=name_of_the_new_phpp)  # -> excel; plug-in component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
write_xl_workbook = BT_WriteXLWorkbook(excel=open_xl_workbook, useDiff=Toggle(False), XL_Objects=entwine)  # -> excel, numWrites; inputs XL_Objects: tree; plug-in component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

read_xl_workbook = BT_ReadXLWorkbook(excel=write_xl_workbook.excel, sheets="Verification", fields="I35", labels="Heating Demand")  # -> data, text; plug-in component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
panel_11 = Panel(read_xl_workbook.data)
list_item_18 = ListItem(List=read_xl_workbook.data, Index="1", Wrap=True)
wallacei_x = WallaceiX(
    Genes=[wlc_1, wlc_2, wlc_3, wlc_4, wlc_5, wlc_6, wlc_7, wlc_8, wlc_9],
    Objectives=list_item_18,
    popGen="-1,-1",
    total="0",
    wlcDone=False)  # -> WallaceiGenomes, FitnessValues, Data, Phenotypes
